# Dynamo graph RengaDyn_Sample_AddDevicesToRoute.dyn (Dynamo 2.12.1.8246)

application = DynRenga.DynDocument.Application.Application()
project = DynRenga.DynDocument.Project.Project.Project(renga_application=application)
model = DynRenga.DynDocument.Model.Model(renga_project=project)

# group: Выборка всех трасс
objectTypes = DynRenga.DynObjects.General.ObjectTypes()
getObjectsByType = DynRenga.DynObjects.Selection.GetObjectsByType(renga_model=model, object_type=objectTypes.Route)

# group: Регистрация свойств и назначение их Трассе
propertyManager = DynRenga.DynProperties.Properties.PropertyManager.PropertyManager(renga_project=project)
названия_и_гуиды_свойств = CodeBlock()
# ---------- названия_и_гуиды_свойств.designscript (8 lines) ----------
["Прибор_начало",
"Прибор_конец",
"Марка_начало",
"Марка_конец"];
["4f336473-b20c-4651-b8a7-fb4cc28483d9",
"059a5177-c543-42f1-a7c4-f05b0c14560b",
"6916f8a0-a711-42eb-b7a1-2bd39025144a",
"0befa932-f1e7-4674-971f-13fcb850a711"];
# ----------------------------------------
guidByString = DynRenga.Other.RengaSimpleInterfaces.GuidByString(guid_str=названия_и_гуиды_свойств.out1)
propertyTypes = DynRenga.DynProperties.Properties.Property.PropertyTypes()
createPropertyDescription = DynRenga.DynProperties.Properties.PropertyManager.CreatePropertyDescription(propertyManager=propertyManager, name=названия_и_гуиды_свойств.out0, property_type=propertyTypes.PropertyType_String)
registerProperty2 = DynRenga.DynProperties.Properties.PropertyManager.RegisterProperty2(propertyManager=propertyManager, property_id=guidByString, prop_description_existed=createPropertyDescription)
code_block = CodeBlock(wait_props=registerProperty2, props_ids=guidByString) { wait_props; props_ids; }
assignPropertyToType = DynRenga.DynProperties.Properties.PropertyManager.AssignPropertyToType(propertyManager=propertyManager, property_id=code_block.props_ids, object_type=objectTypes.Route)
разделение_идентификаторов = CodeBlock(a=guidByString) { a[0]; a[1]; a[2]; a[3]; }  # "Разделение идентификаторов свойств"

ожидание_конца_создания_свойства = CodeBlock(wait_end_assign_prop=assignPropertyToType, objects=getObjectsByType) { wait_end_assign_prop; objects; }
getObjectsData = DynRenga.DynObjects.ModelObject.GetObjectsData(modelObject=ожидание_конца_создания_свойства.objects)

# group: Получение свойств трассы (начального и конечного прибора)
routeParams = DynRenga.DynProperties.Parameters.ObjectsParam.Route.RouteParams.RouteParams(ModelObject_route=ожидание_конца_создания_свойства.objects)
sourceModelObjectId = DynRenga.DynProperties.Parameters.ObjectsParam.Route.RouteParams.SourceModelObjectId(routeParams=routeParams)
targetModelObjectId = DynRenga.DynProperties.Parameters.ObjectsParam.Route.RouteParams.TargetModelObjectId(routeParams=routeParams)
list_create = List.Create(item0=sourceModelObjectId, item1=targetModelObjectId)
getModelObjectById = DynRenga.DynObjects.Selection.GetModelObjectById(renga_model=model, model_object_id=list_create)
name = DynRenga.DynObjects.ModelObject.Name(modelObject=getModelObjectById)
начальный_элемент_на_трассе = CodeBlock(a=name) { a[0]; }
конечный_элемент_на_трассе = CodeBlock(a=name) { a[1]; }

# group: Прибор начала
get = DynRenga.DynProperties.Properties.PropertyContainer.Get(propertyContainer=getObjectsData.Properties_IPropertyContainer, prop_id=разделение_идентификаторов.out0)
setStringValue = DynRenga.DynProperties.Properties.Property.SetStringValue(property=get, value_string=начальный_элемент_на_трассе)

# group: Прибор конца
get_2 = DynRenga.DynProperties.Properties.PropertyContainer.Get(propertyContainer=getObjectsData.Properties_IPropertyContainer, prop_id=разделение_идентификаторов.out1)
setStringValue_2 = DynRenga.DynProperties.Properties.Property.SetStringValue(property=get_2, value_string=конечный_элемент_на_трассе)

# group: Получение связанной марки
getObjectsData_2 = DynRenga.DynObjects.ModelObject.GetObjectsData(modelObject=getModelObjectById)
code_block_2 = CodeBlock { "99FFEDAA-C1BB-4A48-B9C2-4ECC23866830"; }
guidByString_2 = DynRenga.Other.RengaSimpleInterfaces.GuidByString(guid_str=code_block_2)
get_3 = DynRenga.DynProperties.Parameters.ParameterContainer.Get(parameterContainer=getObjectsData_2.Parameters_IParameterContainer, parameter_guid=guidByString_2)
getValue = DynRenga.DynProperties.Parameters.Parameter.GetValue(parameter=get_3)
replace_none = Python(IN[0]=getValue)  # IronPython2
# ---------- replace_none.python (9 lines) ----------
def parse_list(list):
	new_list = []
	for item in list:
		if item == None:
			new_list.append("")
		else:
			new_list.append(item)
	return new_list
OUT = parse_list(IN[0][0]),parse_list(IN[0][1])
# ----------------------------------------
марка_начального_элемента = CodeBlock(a=replace_none) { a[0]; }
марка_конечного_элемента = CodeBlock(a=replace_none) { a[1]; }
code_block_3 = CodeBlock { ""; }

# group: Марка начала
get_4 = DynRenga.DynProperties.Properties.PropertyContainer.Get(propertyContainer=getObjectsData.Properties_IPropertyContainer, prop_id=разделение_идентификаторов.out2)
setStringValue_3 = DynRenga.DynProperties.Properties.Property.SetStringValue(property=get_4, value_string=марка_начального_элемента)

# group: Марка конца
get_5 = DynRenga.DynProperties.Properties.PropertyContainer.Get(propertyContainer=getObjectsData.Properties_IPropertyContainer, prop_id=разделение_идентификаторов.out3)
setStringValue_4 = DynRenga.DynProperties.Properties.Property.SetStringValue(property=get_5, value_string=марка_конечного_элемента)

valueType = DynRenga.DynProperties.Parameters.Parameter.ValueType(parameter=get_3)
