# Dynamo graph RengaDyn_Sample_PropertyTrianglesCount_Getting.dyn (Dynamo 2.12.1.8246)

# group: Получение объектов модели
application = DynRenga.DynDocument.Application.Application()
project = DynRenga.DynDocument.Project.Project.Project(renga_application=application)
model = DynRenga.DynDocument.Model.Model(project=project)
getModelObjects = DynRenga.DynObjects.Selection.GetModelObjects(renga_model=model)
modelObject = DynRenga.DynObjects.ModelObject.ModelObject(model_object_com=getModelObjects)
id = DynRenga.DynObjects.ModelObject.Id(modelObject=modelObject)
getObjectsData = DynRenga.DynObjects.ModelObject.GetObjectsData(modelObject=modelObject)

# group: Получение свойств с сортировкой их для нужного диапазона
propertyContainer = DynRenga.DynProperties.Properties.PropertyContainer.PropertyContainer(PropertyContainer_obj=getObjectsData.Properties_IPropertyContainer)
code_block = CodeBlock { "f2c90cc5-bc21-41a4-acc3-ba8d07345a0e"; }
guidByString = DynRenga.Other.RengaSimpleInterfaces.GuidByString(guid_str=code_block)
get = DynRenga.DynProperties.Properties.PropertyContainer.Get(propertyContainer=propertyContainer, prop_id=guidByString)
property = DynRenga.DynProperties.Properties.Property.Property(Property_obj=get)
getIntegerValue = DynRenga.DynProperties.Properties.Property.GetIntegerValue(property=property)
number = DoubleInput(500)
python_script = Python(IN[0]=getIntegerValue, IN[1]=number)  # IronPython2
# ---------- python_script.python (7 lines) ----------
to_out = []
for a in IN[0]:
	if a != None and a > 0 and a > IN[1]:
		to_out.append(True)
	else:
		to_out.append(False)
OUT = to_out
# ----------------------------------------

# group: Получение идентификаторов НУЖНЫХ объектов модели
filterByBoolMask = List.FilterByBoolMask(list=id, mask=python_script)

# group: На выбор -- выделение объектов
selectObjectsInModelByIds = DynRenga.DynObjects.Selection.SelectObjectsInModelByIds(renga_application=application, model_objects_ids=filterByBoolMask.in)  # frozen

# group: На выбор -- изоляция объектов
activeView = DynRenga.DynDocument.Application.ActiveView(application=application)  # frozen
modelView = DynRenga.DynDocument.Views.ModelView.ModelView(view_object=activeView)
code_block_2 = CodeBlock { true; }
setObjectsVisibility = DynRenga.DynDocument.Views.ModelView.SetObjectsVisibility(modelView=modelView, object_ids=filterByBoolMask.in, visiable=code_block_2)
