# Dynamo graph RengaDyn_Sample_SetPropertyTrianglesCount.dyn (Dynamo 2.12.1.8246)

application = DynRenga.DynDocument.Application.Application()
project = DynRenga.DynDocument.Project.Project.Project(renga_application=application)
propertyManager = DynRenga.DynProperties.Properties.PropertyManager.PropertyManager(renga_project=project)

# group: Создание нового свойства и регистрация его в программе
идентификатор_свойства = CodeBlock { "f2c90cc5-bc21-41a4-acc3-ba8d07345a0e"; }
guidByString = DynRenga.Other.RengaSimpleInterfaces.GuidByString(guid_str=идентификатор_свойства)
code_block = CodeBlock { "Количество_3d-граней"; }
propertyTypes = DynRenga.DynProperties.Properties.Property.PropertyTypes()
createPropertyDescription = DynRenga.DynProperties.Properties.PropertyManager.CreatePropertyDescription(propertyManager=propertyManager, name=code_block, property_type=propertyTypes.PropertyType_Integer)
registerProperty2 = DynRenga.DynProperties.Properties.PropertyManager.RegisterProperty2(propertyManager=propertyManager, property_id=guidByString, prop_description_existed=createPropertyDescription)

# group: Назначение свойства всем категориям оьъектов Renga
allObjectTypes = DynRenga.DynObjects.General.AllObjectTypes()
code_block_2 = CodeBlock(a=registerProperty2, types=allObjectTypes) { a; types; }
assignPropertyToType = DynRenga.DynProperties.Properties.PropertyManager.AssignPropertyToType(propertyManager=propertyManager, property_id=guidByString, object_type=code_block_2.types)

# group: Пауза для ожидания процесса создания свойств
list_create = List.Create(item0=assignPropertyToType)
code_block_3 = CodeBlock(project=project, wait=list_create) { project; wait; }

# group: Получение объектов модели, для которых есть геометрическое представление
model = DynRenga.DynDocument.Model.Model(renga_project=code_block_3.project)
getModelObjects = DynRenga.DynObjects.Selection.GetModelObjects(renga_model=model)
id = DynRenga.DynObjects.ModelObject.Id(modelObject=getModelObjects)
dataExporter = DynRenga.DynDocument.DataExporter.DataExporter(renga_project=code_block_3.project)
exportedObject3D = DynRenga.DynObjects.ExportedObject3D.ExportedObject3D(DataExporter=dataExporter, modelobject_id=id)

checkIsNotNull = DynRenga.Other.Technical.CheckIsNotNull(ClassForCheck=exportedObject3D)

# group: Получение свойства количества 3д-граней и самих объектов модели
filterByBoolMask = List.FilterByBoolMask(list=id, mask=checkIsNotNull)
getModelObjectById = DynRenga.DynObjects.Selection.GetModelObjectById(renga_model=model, model_object_id=filterByBoolMask.in)
exportedObject3D_2 = DynRenga.DynObjects.ExportedObject3D.ExportedObject3D(DataExporter=dataExporter, modelobject_id=filterByBoolMask.in)
getTrianglesCount = DynRenga.DynObjects.ExportedObject3D.GetTrianglesCount(exportedObject3D=exportedObject3D_2)

# group: Назначение значение свойства объекту модели
getObjectsData = DynRenga.DynObjects.ModelObject.GetObjectsData(modelObject=getModelObjectById)
get = DynRenga.DynProperties.Properties.PropertyContainer.Get(propertyContainer=getObjectsData.Properties_IPropertyContainer, prop_id=guidByString)
setIntegerValue = DynRenga.DynProperties.Properties.Property.SetIntegerValue(property=get, value_int=getTrianglesCount)

name = DynRenga.DynProperties.Properties.Property.Name(property=get)
