# Dynamo graph test_selection.dyn (Dynamo 2.12.1.8246)

application = DynRenga.DynDocument.Application.Application()
project = DynRenga.DynDocument.Project.Project.Project(renga_application=application)
model = DynRenga.DynDocument.Model.Model(project=project)
getSelectedObjectsIdByUser = DynRenga.DynObjects.Selection.GetSelectedObjectsIdByUser(renga_application=application)
getModelObjectById = DynRenga.DynObjects.Selection.GetModelObjectById(renga_model=model, model_object_id=getSelectedObjectsIdByUser)
